# Grasshopper definition Attractor Points for Algorithm.gh (Grasshopper 0.9.76)
# plug-ins: PTComponentLibrary

ptplanar = PlanarGrid(
    BasePoint=Point(1, 11, 5.971309368),
    IDir=Vector(0, -9, 0),
    JDir=Vector(19, 0, 0),
    IDistance=1,
    JDistance=1,
    INumber=7,
    JNumber=6)
pt = Point(flatten(ptplanar))
pt_2 = Point(<point referenced from the Rhino model>)
dist = Distance(PointA=pt, PointB=pt_2)
division = Division(A=dist, B=Slider(11, range=0..30))
rectangle = Rectangle(Plane=pt, XSize=division, YSize=division, Radius=0)  # -> Rectangle, Length
srf = Surface(reparameterize(rectangle.Rectangle))
dup = DuplicateData(Data=srf, Number=2, Order=True)
mirror = Mirror(Geometry=dup, Plane=Plane(origin=(8, 0, 0), x=(0, 0, 1), y=(0, 1, 0)))  # -> Geometry, Transform
srf_2 = Surface([srf, mirror.Geometry])
dup_2 = DuplicateData(Data=srf_2, Number=2, Order=True)
mirror_2 = Mirror(Geometry=dup_2, Plane=Plane(origin=(7.983440314, 5.628842366, 0), x=(0, 0, 1), y=(0.999991786, 0.004053134306, 0)))  # -> Geometry, Transform
srf_3 = Surface([srf_2, mirror_2.Geometry])
