# Grasshopper definition Graph Mapper Facade.gh (Grasshopper 0.9.76)

line = Line(Line((0, 0, 10), (15, 0, 10)))
line_2 = Line(Line((0, 0, 10), (15, 0, 10)))
divide = DivideCurve(Curve=line, Count=15, Kinks=False)  # -> Points, Tangents, Parameters
divide_2 = DivideCurve(Curve=line_2, Count=15, Kinks=False)  # -> Points, Tangents, Parameters
pdecon = Deconstruct(Point=divide.Points)  # -> XComponent, YComponent, ZComponent
range = Range(Domain=pdecon.ZComponent, Steps=15)
pdecon_2 = Deconstruct(Point=divide_2.Points)  # -> XComponent, YComponent, ZComponent
range_2 = Range(Domain=pdecon_2.ZComponent, Steps=15)
graph = GraphMapper(
    range,
    x0=0,
    x1=15,
    y0=0,
    y1=30,
    container_name="Bezier",
    cpx=[0, 0.3987730145, 0.9877300858, 1],
    cpy=[0, 0.2117646933, 0.02352941036, 0.7328584194])
graph_2 = GraphMapper(range_2, x0=0, x1=15, y0=9, y1=30, container_name="Conic", Cx=0.6376811862, Cy=0.1449275613)
pt = ConstructPoint(XCoordinate=pdecon.XComponent, YCoordinate=0, ZCoordinate=graph)
pt_2 = ConstructPoint(XCoordinate=pdecon_2.XComponent, YCoordinate=0, ZCoordinate=graph_2)
nurbs = NurbsCurve(Vertices=pt, Degree=3, Periodic=False)  # -> Curve, Length, Domain
nurbs_2 = NurbsCurve(Vertices=pt_2, Degree=3, Periodic=False)  # -> Curve, Length, Domain
loft = Loft(
    Curves=[nurbs.Curve, nurbs_2.Curve],
    Options={Adjust=False, Closed=False, LoftEnds=0, LoftSimp=0, LoftType=0, Rebuild=10, Refit=0.01})  # -> flatten(Loft)
item = ListItem(List=loft, Index=0, Wrap=True)
