# Grasshopper definition Menger Sponge.gh (Grasshopper 0.9.76)

# ---- group: Base Case
box = Box({Plane=Plane(origin=(0, 0, 0), x=(0, 1, 0), y=(1, 0, 0)), X=Domain(0, 16), Y=Domain(0, 16), Z=Domain(-16, 0)})
arrbox = BoxArray(Geometry=box, Cell=box, XCount=3, YCount=3, ZCount=3)  # -> Geometry, Transform
cull_i = CullIndex(List=arrbox.Geometry, Indices=[4, 12, 13, 14, 10, 16, 22], Wrap=True)

# ----
box_2 = Box(flatten(cull_i))
scale = Scale(Geometry=box_2, Center=Point(0, 0, 0), Factor=0.3333333333)  # -> Geometry, Transform
arrbox_2 = BoxArray(Geometry=scale.Geometry, Cell=box, XCount=3, YCount=3, ZCount=3)  # -> Geometry, Transform
cull_i_2 = CullIndex(List=arrbox_2.Geometry, Indices=[4, 12, 13, 14, 10, 16, 22], Wrap=True)
box_3 = Box(flatten(cull_i_2))
scale_2 = Scale(Geometry=box_3, Center=Point(0, 0, 0), Factor=0.3333333333)  # -> Geometry, Transform
arrbox_3 = BoxArray(Geometry=scale_2.Geometry, Cell=box, XCount=3, YCount=3, ZCount=3)  # -> Geometry, Transform
cull_i_3 = CullIndex(List=arrbox_3.Geometry, Indices=[4, 12, 13, 14, 10, 16, 22], Wrap=True)
